# Grasshopper definition Assignment5_HS.gh (Grasshopper 1.0.7)

# ---- group: User Defined Variebles
width = Slider(69.5, range=0..100)
height = Slider(405, range=0..1000)
run = Slider(764, range=0..1000)
list = ValueList({"straightforward": 1, "L-shaped": 2, "U-shaped": 3, "Spiral": 4}, selected="U-shaped")

# ----
# PLease note that if the component gives error that means your entered height and run amount is not acceptable based on ADA stairCase Standards.
# 
# Consider changing that!
staircase = GhPythonScript(height=height, run=run, width=width, type=list)  # -> SC, SN, ST, SR, SL; inputs type: Int32
# ---------- staircase: Python ----------
__author__ = "Hanieh Sotudeh"
__version__ = "2021.11.21"

import rhinoscriptsyntax as rs
import math
import ghpythonlib.components as gh
import copy

"""ADA requirements:
    Stairs:
        Thread > 11 in (280 mm)
        Nosing < 1-1/2 in (38 mm)
        Leading edge curvature radius < 1/2 in (13 mm)
        4 < Riser Height < 7
        Riser >> 1.Sloped 2.angle > 60 degree

    Landing:
        Landing >> every 12 feet vertical rise (144 in)
        Landing >= Width

    Handrails: 
        *Continuous on both sides
        
    Slop:
        30 <stair slop < 50
    """

class StairCase:
    def __init__(self, height, width, run, type):
        self.height = height
        self.width = width
        self.run = run
        self.type = type
        
    # This function returns the number of Landings based on the entered height
    def LandingNumber(self):
        N = int (math.ceil((height / 144)) + 1)
        return N
        
    # This function returns the number of stairs, thread, and rising based on eneterd height
    def StairNum (self):
        # Calculation of stair numbers based on stair rise standards which is between 4 and 7 inch
        Min0 = int (math.ceil(self.height / 7))
        Max0 = int(self.height / 4)
        # First acceptable range of stairs based on height calculations
        range1 = (Min0,Max0)
        
        # Validating the run amount based on ADA standards
        MinRun = Min0 * 11
        if self.run <= MinRun:
            raise NameError("The run amount should be higher than {}, Consider Changing it!".format(MinRun))

        #Number of stairs
        Thread = 11   # ADA Minimum requirement
        StairN = int (self.run /11)
        # Make the Thread bigger if required (based on the User entered run amount)
        if StairN > Max0:
            Thread = self.run/Max0
            StairN = Max0
        Rising = self.height / StairN
        return StairN , Thread, Rising
        
    # This function models Straightforward stair
    def Straightforward (self):
        # get the required numbers from previous functions
        StairN = StairCase(height, width, run, type).StairNum()[0]
        Thread = StairCase(height, width, run, type).StairNum()[1]
        Rising = StairCase(height, width, run,type).StairNum()[2]
        Landing = StairCase(height, width, run, type).LandingNumber()
        # Create an empty list to get the stairs top points
        StairPts = []
        # Creat an empty list to get the staris bottom points
        BottomPts = []

        # Creat Sub list of each cluster of stairs between two consecutive landing
        Landings = []
       
        # Calculate the approximate number of each cluster
        ApproxNum = math.ceil (StairN/(Landing-1))
        # Create a nested list of cluster of stairs
        for j in range (Landing-1):
            SubStairsN = []
            for i in range (StairN):
                if i < (ApproxNum) * (j+1) and i >= (ApproxNum)* (j):
                    SubStairsN.append(i)
            Landings.append(SubStairsN)
        
        # Creat stairs for each sublist
        for j in range (len(Landings)):
            # Go over each cluster 
            for i in Landings[j]:
                # First exception to Creat the first Landing 
                if j == 0 and i == Landings[j][0]:
                    pt0 = rs.AddPoint(0,((i) * Thread)+ ((j) * self.width) ,((i) *Rising ))
                    StairPts.append(pt0)
                    
                # Get first and last point of each cluster to create the bottom points
                if i == Landings[j][0]:
                    pt00 = rs.AddPoint(0,((i) * Thread)+ ((j) * self.width) , ((i-1) *Rising ))
                    pt11 = rs.AddPoint(0,((i) * Thread) + ((j+1) * self.width),((i-1) *Rising))
                    BottomPts.append(pt00)
                    BottomPts.append(pt11)
                    
                # Create the top points for each stair
                pt1 = rs.AddPoint(0,((i) * Thread) + ((j+1) * self.width),((i) *Rising))
                pt2 = rs.AddPoint(0, ((i) * Thread) + ((j+1) * self.width), ((i+1) *Rising))
                StairPts.append(pt1)
                StairPts.append(pt2)
                
                # Last exception to create the last landing
                if j == len(Landings)-1 and i == Landings[j][-1] :
                    pt3 = rs.AddPoint(0,((i+1) * Thread)+ ((j+2) * self.width) ,((i+1) *Rising ))
                    StairPts.append(pt3)
                    
                    # Create the bottom points for the last landing
                    pt22 = rs.AddPoint(0, ((i+1) * Thread) + ((j+1) * self.width),((i) *Rising))
                    pt33 = rs.AddPoint(0,((i+1) * Thread)+ ((j+2) * self.width) ,((i) *Rising))
                    BottomPts.append(pt22)
                    BottomPts.append(pt33)
        # Reverse the order of bottom points 
        BottomPts.reverse()
        # Join the bottom points to the top points
        for pt in BottomPts:
            StairPts.append(pt)
        # Add the last point to the list to make a close polyline
        StairPts.append(StairPts[0])
        # Create a close polyline
        Outline = rs.AddPolyline(StairPts)
        # Create close for extrusion
        BoundarySrf = rs.AddPlanarSrf(Outline)
        # Create the path for extrusion
        Path = rs.AddLine([0,0,0], [self.width,0,0])
        # extrude boundary surface
        StairC = rs.ExtrudeSurface(BoundarySrf,Path, True)
        return StairC
        
    # This function models Straightforward stair
    def L_Shape (self):
        # get the required numbers from previous functions
        StairN = StairCase(height, width, run,type).StairNum()[0]
        Thread = StairCase(height, width, run, type).StairNum()[1]
        Rising = StairCase(height, width, run, type).StairNum()[2]
        Landing = StairCase(height, width, run,type).LandingNumber()
        # Create an empty list to get the stairs top points
        StairPts = []
        # Creat an empty list to get the staris bottom points
        BottomPts = []
        StairCs = []
        # Creat Sub list of each cluster of stairs between two consecutive landing
        Landings = []
        # Calculate the approximate number of each cluster
        ApproxNum = math.floor (StairN/(Landing-1))
        # Create a Data tree of stairs
        for j in range (Landing-1):
            SubStairsN = []
            if j != Landing-2:
                for i in range (StairN):
                    if i < (ApproxNum) * (j+1) and i >= (ApproxNum)* (j):
                        SubStairsN.append(i)
                Landings.append(SubStairsN)
            # Add extra Stairs to the last Arm
            else:
                for i in range (StairN):
                    if i >= (ApproxNum) *(Landing-2) :
                        SubStairsN.append(i)
                Landings.append(SubStairsN)
   
            
        # Creat stairs for each sublist
        for j in range (len(Landings)):
            SubStairPts = []
            SubBottomPts = []
            # Go over each cluster 
            # Seperate each arm
            # Arm Number 0
            if j % 4 == 0:
                for i in Landings[j]:
                    # The index of Stair in each Landing
                    iic = i - int(Landings[j][0])
                    # Calculations for Rising and Thread of Stairs
                    Y2 = ((iic+1) * Thread)+ self.width
                    Y1 = ((iic) * Thread)+ self.width
                    Y0 = ((iic) * Thread)
                    Z1 = ((i) *Rising )
                    Z0 = ((i-1) *Rising )
                    Z2 = ((i+1) *Rising )
                    # First exception to Creat the first Landing 
                    if  i == Landings[j][0]:
                        pt0 = rs.AddPoint(0,Y0 ,Z1)
                        SubStairPts.append(pt0)
                        
                        pt00 = rs.AddPoint(0,Y0 ,Z0)
                        pt11 = rs.AddPoint(0,Y1,Z0)
                        SubBottomPts.append(pt00)
                        SubBottomPts.append(pt11)
                    # Create the top points for each stair
                    pt1 = rs.AddPoint(0, Y1, Z1)
                    pt2 = rs.AddPoint(0, Y1, Z2)
                    SubStairPts.append(pt1)
                    SubStairPts.append(pt2)
                
                    # Last exception to create the last landing
                    if i == Landings[j][-1] :
                        pt3 = rs.AddPoint(0,Y2 + self.width,Z2)
                        SubStairPts.append(pt3)
                        
                        # Create the bottom points for the last landing
                        pt22 = rs.AddPoint(0, Y2 + self.width, Z1)
                        pt33 = rs.AddPoint(0, Y2, Z1)
                        SubBottomPts.append(pt33)
                        SubBottomPts.append(pt22)
                # Reverse the bottom points to add to the top points and create the section polyline of stairs
                SubBottomPts.reverse()
                for i in SubBottomPts:
                    SubStairPts.append(i)
                    
                SubStairPts.append(SubStairPts[0])
                Outline = rs.AddPolyline(SubStairPts)
                # Create close for extrusion
                BoundarySrf = rs.AddPlanarSrf(Outline)
                # Create the path for extrusion
                Path = rs.AddLine([0,0,0], [-self.width,0,0])
                # extrude boundary surface
                StairC = rs.ExtrudeSurface(BoundarySrf,Path, True)
                StairCs.append(StairC)
                
            # Arm Number 1
            elif j % 4 == 1:
                for i in Landings[j]:
                    iic = i - int(Landings[j][0])
                    Y2 = ((iic+1) * Thread)+ self.width
                    Y1 = ((iic) * Thread)+ self.width
                    Z1 =  ((i) *Rising )
                    Z0 = ((i-1) *Rising )
                    Z2 = ((i+1) *Rising )
                    # Get first and last point of each cluster to create the bottom points
                    if i == Landings[j][0]:
                        pt00 = rs.AddPoint(0,Y0 ,Z0)
                        pt11 = rs.AddPoint((iic * Thread),((len(Landings[j-1]))* Thread)+ self.width,Z0)
                        #SubBottomPts.append(pt00)
                        SubBottomPts.append(pt11)
                    # Create the top points for each stair
                    pt1 = rs.AddPoint((iic * Thread), ((len(Landings[j-1]))* Thread) + self.width ,((i) *Rising))
                    pt2 = rs.AddPoint((iic * Thread), ((len(Landings[j-1]))* Thread)  + self.width ,((i+1) *Rising))
                    SubStairPts.append(pt1)
                    SubStairPts.append(pt2)
                    # Last exception to create the last landing
                    if i == Landings[j][-1] :
                        pt3 = rs.AddPoint((len(Landings[j]))*Thread + self.width,((len(Landings[j-1]))* Thread) + self.width,Z2)
                        SubStairPts.append(pt3)
                        
                        # Create the bottom points for the last landing
                        pt22 = rs.AddPoint((len(Landings[j]))*Thread + self.width, ((len(Landings[j-1]))* Thread)  + self.width , Z1)
                        pt33 = rs.AddPoint((len(Landings[j]))*Thread,((len(Landings[j-1]))* Thread)  + self.width ,Z1)
                        SubBottomPts.append(pt33)
                        SubBottomPts.append(pt22)
                        
                SubBottomPts.reverse()
                
                for i in SubBottomPts:
                    SubStairPts.append(i)
                SubStairPts.append(SubStairPts[0])
                
                Outline = rs.AddPolyline(SubStairPts)
                # Create close for extrusion
                BoundarySrf = rs.AddPlanarSrf(Outline)
                # Create the path for extrusion
                Path = rs.AddLine([0,0,0], [0,self.width,0])
                # extrude boundary surface
                StairC = rs.ExtrudeSurface(BoundarySrf,Path, True)
                StairCs.append(StairC)
                
            # Arm Number 2
            elif j % 4 == 2:
                for i in Landings[j]:
                    iic = i - int(Landings[j][0])
                    Y1 = ((iic) * Thread)+ self.width
                    Z1 = ((i) *Rising )
                    Z0 = ((i-1) *Rising )
                    Z2 = ((i+1) *Rising )
                    X0 = (len(Landings[j])* Thread)
                    SubRun = (len(Landings[j-2])* Thread)+(self.width *2)
                    # Get first and last point of each cluster to create the bottom points
                    if i == Landings[j][0]:
                        pt00 = rs.AddPoint(X0,SubRun -Y1,Z0)
                        SubBottomPts.append(pt00)
                    # Create the top points for each stair
                    pt1 = rs.AddPoint(X0,SubRun-Y1, Z1)
                    pt2 = rs.AddPoint(X0,SubRun-Y1, Z2)
                    SubStairPts.append(pt1)
                    SubStairPts.append(pt2)
                    if i == Landings[j][-1] :
                        pt3 = rs.AddPoint(X0,SubRun-Y1 - self.width-Thread, Z2)
                        SubStairPts.append(pt3)
                        
                        # Create the bottom points for the last landing
                        pt22 = rs.AddPoint(X0,SubRun-Y1 - self.width- Thread, Z1)
                        pt33 = rs.AddPoint(X0,SubRun-Y1 - Thread, Z1)
                        SubBottomPts.append(pt33)
                        SubBottomPts.append(pt22)
                        
                SubBottomPts.reverse()
                
                for i in SubBottomPts:
                    SubStairPts.append(i)
                SubStairPts.append(SubStairPts[0])
                Outline = rs.AddPolyline(SubStairPts)
                # Create close for extrusion
                BoundarySrf = rs.AddPlanarSrf(Outline)
                # Create the path for extrusion
                Path = rs.AddLine([0,0,0], [self.width,0,0])
                # extrude boundary surface
                StairC = rs.ExtrudeSurface(BoundarySrf,Path, True)
                StairCs.append(StairC)
                
            #Arm Number 3
            elif j % 4 == 3:
                for i in Landings[j]:
                    iic = i - int(Landings[j][0])
                    Y1 = ((iic) * Thread)+ self.width
                    Z1 = ((i) *Rising )
                    Z2 =  ((i+1) *Rising )
                    SubRun = (len(Landings[j-2])* Thread)+self.width 
                    # Get first and last point of each cluster to create the bottom points
                    # Create the top points for each stair
                    pt1 = rs.AddPoint(SubRun-Y1,self.width, Z1)
                    pt2 = rs.AddPoint(SubRun-Y1,self.width, Z2)
                    SubStairPts.append(pt1)
                    SubStairPts.append(pt2)
                    if i == Landings[j][-1] :
                        pt3 = rs.AddPoint(SubRun-Y1-Thread,self.width, Z2)
                        SubStairPts.append(pt3)
                        
                        # Create the bottom points for the last landing
                        pt22 = rs.AddPoint(SubRun-Y1-self.width-Thread,self.width, Z1)
                        pt33 = rs.AddPoint(SubRun-Y1-self.width-Thread,self.width, Z2)
                        pt44 = rs.AddPoint(SubRun-Y1-Thread,self.width, Z1)
                        
                        pt55 = rs.AddPoint((len(Landings[j-2]))*Thread,self.width, (i-iic-1)*Rising)
                        SubBottomPts.append(pt55)
                        SubBottomPts.append(pt44)
                        SubBottomPts.append(pt22)
                        SubBottomPts.append(pt33)
                        
                        
                SubBottomPts.reverse()
                for i in SubBottomPts:
                    SubStairPts.append(i)
                SubStairPts.append(SubStairPts[0])
                Outline = rs.AddPolyline(SubStairPts)
                # Create close for extrusion
                BoundarySrf = rs.AddPlanarSrf(Outline)
                # Create the path for extrusion
                Path = rs.AddLine([0,0,0], [0,-self.width,0])
                # extrude boundary surface
                StairC = rs.ExtrudeSurface(BoundarySrf,Path, True)
                StairCs.append(StairC)
                
        return StairCs

    # This function models Straightforward stair
    def U_Shape (self):
        # get the required numbers from previous functions
        StairN = StairCase(height, width, run,type).StairNum()[0]
        Thread = StairCase(height, width, run,type).StairNum()[1]
        Rising = StairCase(height, width, run,type).StairNum()[2]
        Landing = StairCase(height, width, run, type).LandingNumber()
        # Create an empty list to get the stairs top points
        StairPts = []
        # Creat an empty list to get the staris bottom points
        BottomPts = []
        StairCs = []
        # Creat Sub list of each cluster of stairs between two consecutive landing
        Landings = []
        # Calculate the approximate number of each cluster
        ApproxNum = math.floor (StairN/(Landing-1))
        # Create a Data tree of stairs
        for j in range (Landing-1):
            SubStairsN = []
            if j != Landing-2:
                for i in range (StairN):
                    if i < (ApproxNum) * (j+1) and i >= (ApproxNum)* (j):
                        SubStairsN.append(i)
                Landings.append(SubStairsN)
            else:
                for i in range (StairN):
                    if i >= (ApproxNum) *(Landing-2) :
                        SubStairsN.append(i)
                Landings.append(SubStairsN)
   
            
        # Creat stairs for each sublist
        for j in range (len(Landings)):
            SubStairPts = []
            SubBottomPts = []
            # Go over each cluster 
            # Seperate each arm
            if j % 2 == 0:
                for i in Landings[j]:
                    iic = i - int(Landings[j][0])
                    Y2 = ((iic+1) * Thread)+ self.width
                    Y1 = ((iic) * Thread)+ self.width
                    Y0 = ((iic) * Thread)
                    Z1 = ((i) *Rising )
                    Z0 = ((i-1) *Rising )
                    Z2 = ((i+1) *Rising )
                    # First exception to Creat the first Landing 
                    if  i == Landings[j][0]:
                        pt0 = rs.AddPoint(0,Y0 ,Z1)
                        SubStairPts.append(pt0)
                        
                        pt00 = rs.AddPoint(0,Y0 ,Z0)
                        pt11 = rs.AddPoint(0,Y1,Z0)
                        SubBottomPts.append(pt00)
                        SubBottomPts.append(pt11)
                    # Create the top points for each stair
                    pt1 = rs.AddPoint(0, Y1, Z1)
                    pt2 = rs.AddPoint(0, Y1, Z2)
                    SubStairPts.append(pt1)
                    SubStairPts.append(pt2)
                
                    # Last exception to create the last landing
                    if i == Landings[j][-1] :
                        pt3 = rs.AddPoint(0,Y2 + self.width,Z2)
                        SubStairPts.append(pt3)
                        
                        # Create the bottom points for the last landing
                        pt22 = rs.AddPoint(0, Y2 + self.width, Z1)
                        pt33 = rs.AddPoint(0, Y2, Z1)
                        SubBottomPts.append(pt33)
                        SubBottomPts.append(pt22)
                        
                SubBottomPts.reverse()
                
                for i in SubBottomPts:
                    SubStairPts.append(i)
                    
                SubStairPts.append(SubStairPts[0])
                Outline = rs.AddPolyline(SubStairPts)
                # Create close for extrusion
                BoundarySrf = rs.AddPlanarSrf(Outline)
                # Create the path for extrusion
                Path = rs.AddLine([0,0,0], [-self.width,0,0])
                # extrude boundary surface
                StairC = rs.ExtrudeSurface(BoundarySrf,Path, True)
                StairCs.append(StairC)
            
            elif j % 2 == 1:
                for i in Landings[j]:
                    iic = i - int(Landings[j][0])
                    Y1 = ((iic) * Thread)+ self.width
                    Z1 = ((i) *Rising )
                    Z0 =((i-1) *Rising )
                    Z2 = ((i+1) *Rising )
                    X0 = 0
                    SubRun = (len(Landings[j-1])* Thread)+(self.width *2)
                    # Get first and last point of each cluster to create the bottom points
                    if i == Landings[j][0]:
                        pt00 = rs.AddPoint(X0,SubRun-Y1 + self.width, Z1)
                        pt01 = rs.AddPoint(X0,SubRun-Y1 + self.width, Z0)
                        pt11 = rs.AddPoint(X0,SubRun -Y1,Z0)
                        
                        SubBottomPts.append(pt00)
                        SubBottomPts.append(pt01)
                        
                        SubBottomPts.append(pt11)
                        
                    # Create the top points for each stair
                    pt1 = rs.AddPoint(X0,SubRun-Y1, Z1)
                    pt2 = rs.AddPoint(X0,SubRun-Y1, Z2)
                    SubStairPts.append(pt1)
                    SubStairPts.append(pt2)
                    if i == Landings[j][-1] :
                        pt3 = rs.AddPoint(X0,SubRun-Y1 - self.width-Thread, Z2)
                        SubStairPts.append(pt3)
                        
                        # Create the bottom points for the last landing
                        pt22 = rs.AddPoint(X0,SubRun-Y1 - self.width- Thread, Z1)
                        pt33 = rs.AddPoint(X0,SubRun-Y1 - Thread, Z1)
                        SubBottomPts.append(pt33)
                        SubBottomPts.append(pt22)
                        
                SubBottomPts.reverse()
                
                for i in SubBottomPts:
                    SubStairPts.append(i)
                SubStairPts.append(SubStairPts[0])
                Outline = rs.AddPolyline(SubStairPts)
                # Create close for extrusion
                BoundarySrf = rs.AddPlanarSrf(Outline)
                # Create the path for extrusion
                Path = rs.AddLine([0,0,0], [self.width,0,0])
                # extrude boundary surface
                StairC = rs.ExtrudeSurface(BoundarySrf,Path, True)
                StairCs.append(StairC)

        return StairCs
        
    # This function models Straightforward stair
    def Spiral (self):
        # get the required numbers from previous functions
        StairN = StairCase(height, width, run, type).StairNum()[0]
        Thread = StairCase(height, width, run,  type).StairNum()[1]
        Rising = StairCase(height, width, run, type).StairNum()[2]
        Landing = StairCase(height, width, run, type).LandingNumber()
        # Creat an empty list to get the staris bottom points
        StairCs = []
        # Creat Sub list of each cluster of stairs between two consecutive landing
        Landings = []
        # Calculate the approximate number of each cluster
        ApproxNum = math.floor (StairN/(Landing-1))
        # Create a Data tree of stairs
        for j in range (Landing-1):
            SubStairsN = []
            if j != Landing-2:
                for i in range (StairN):
                    if i < (ApproxNum) * (j+1) and i >= (ApproxNum)* (j):
                        SubStairsN.append(i)
                Landings.append(SubStairsN)
            else:
                for i in range (StairN):
                    if i > (ApproxNum) *(Landing-2) :
                        SubStairsN.append(i)
                Landings.append(SubStairsN)
                
        # Inside hole 
        GapWidth = 12
        CenterPt = rs.AddPoint(0,0,0)
        # Creat the stair holding cylinder
        Cylender = rs.AddCylinder(rs.coerce3dpoint(CenterPt),Landings[-1][-1]* Rising,GapWidth+0.1,True)
        # Create a list to add the stairs
        Stairs = []
        # Add the Cylinder to the Stair
        Stairs.append(Cylender)
        
        # The innder circle of the Stairs
        StartCrcl = rs.AddCircle(CenterPt,GapWidth)
        # The inner Circle's Domain
        StartCrclD = gh.CurveDomain(rs.coercecurve(StartCrcl))
        # The inner Circle length
        LenS = gh.Length(rs.coercecurve(StartCrcl))
        
        # The Outer Circle of the Stairs 
        EndCrcl = rs.AddCircle(CenterPt,GapWidth + (self.width))
        #The inner Circle length
        LenE = gh.Length(rs.coercecurve(EndCrcl))
        # The outer Circle domain
        EndCrclD = gh.CurveDomain(rs.coercecurve(EndCrcl))
        
        # The Middle Circle
        MidCrcl = rs.AddCircle(CenterPt,GapWidth + (self.width/2))
        # The Middle Circle length
        Len = gh.Length(rs.coercecurve(MidCrcl))
        # The Middle Circle Domain 
        MidCrclD = gh.CurveDomain(rs.coercecurve(MidCrcl))
        
        # End Segments (Outter) Segments
        SegmentsE = []
        # Start(innder) Segments
        SegmentsS = []
        
        dist = 0
        ThreadList = []
        # Create a data tree of Threads in the Stair case (addig landing every 144 inch height)
        # Each branch of data tree presents the segmentations in a circle 
        for j in range (len(Landings)):
            SubThreadList = []
            for i in Landings[j]:
                if i ==  Landings[j][0]:
                    SubThreadList.append(dist)
                    dist += Thread
                elif i != Landings[j][-1]:
                    dist = dist % Len
                    dist += Thread
                else:
                    dist = dist % Len
                    dist += Len/4
                SubThreadList.append(dist)
            ThreadList.append(SubThreadList)

        index = 1
        # A nested for loop to go over each branch in created thread data tree, Shatter the Circle and move each segments to get the edge of stairs
        for i in range(len(ThreadList)):
            for j in range(len(ThreadList[i])-1):
                # Get the t parameteres based on the middld curve to shatter the circle
                Param1 = int(ThreadList[i][j]) % Len
                Param2 = int(ThreadList[i][j+1]) % Len
                # reparameterize the t parameters in the outer and inner circle using curve domain
                # outer circle
                ReparamParamEj = gh.RemapNumbers(Param1 ,MidCrclD,EndCrclD)
                ReparamParamEk = gh.RemapNumbers(Param2 ,MidCrclD,EndCrclD)
                # inner circle
                ReparamParamSj = gh.RemapNumbers(Param1,MidCrclD,StartCrclD)
                ReparamParamSk = gh.RemapNumbers(Param2,MidCrclD,StartCrclD)
                # shatter the circles
                SubSegmentsE = gh.Shatter(rs.coercecurve(EndCrcl),[ReparamParamEj[0][0],ReparamParamEk[0][0]])
                SubSegmentsS = gh.Shatter(rs.coercecurve(StartCrcl),[ReparamParamSj[0][0],ReparamParamSk[0][0]])
                SrfLines = []
                
                # A foor loop to compare the length of each segment and pick the smallest one
                for k in range(2):
                # shallow copy of the ArcCurve
                    if gh.Length(SubSegmentsS[1])>gh.Length(SubSegmentsS[0]):
                        SegSCopy = copy.copy(SubSegmentsS[0])
                        SegECopy = copy.copy(SubSegmentsE[0])
                    else:
                        SegSCopy = copy.copy(SubSegmentsS[1])
                        SegECopy = copy.copy(SubSegmentsE[1])

                # Move the segments to get the edge of stair
                CrvA = rs.MoveObject(SegSCopy,(0,0,index*Rising))
                CrvB = rs.MoveObject(SegECopy,(0,0,index*Rising))
                # Connecte the endpoints of the segments to get the Lines
                LineA = rs.AddLine(gh.EndPoints(rs.coercecurve(CrvA))[0],gh.EndPoints(rs.coercecurve(CrvB))[0])
                LineB = rs.AddLine(gh.EndPoints(rs.coercecurve(CrvA))[1],gh.EndPoints(rs.coercecurve(CrvB))[1])
                # Add all of the edge to the surface List
                SrfLines.append(CrvA)
                SrfLines.append(CrvB)
                SrfLines.append(LineA)
                SrfLines.append(LineB)
                # Join the edges and create a planner surface
                Srf = rs.AddPlanarSrf(rs.JoinCurves(SrfLines))
                # Create the path for extrusion
                Path = rs.AddLine([0,0,0], [0,0,-2])
                # extrude boundary surface
                Stair = rs.ExtrudeSurface(Srf,Path, True)
                Stairs.append(Stair)
                index +=1
        return Stairs

# This function decides to draw the appropriate stair based on what user entered.
    def DrawStairCase (self):
        SC = []
        if self.type ==1:
            SC = StairCase(height, width, run, type).Straightforward()
        elif self.type ==2:
            SC =StairCase(height, width, run, type).L_Shape()
        elif self.type ==3:
            SC =StairCase(height, width, run, type).U_Shape()
        elif self.type ==4:
            SC =StairCase(height, width, run,type).Spiral()
        return SC
        
SC= StairCase(height, width, run, type).DrawStairCase()
SN = StairCase(height, width, run, type).StairNum()[0]
ST = StairCase(height, width, run,  type).StairNum()[1]
SR = Rising = StairCase(height, width, run,type).StairNum()[2]
SL = Landing = StairCase(height, width, run, type).LandingNumber()
# ---------- end staircase ----------

stair_landings = Data(staircase.SL)
stair_number = Data(staircase.SN)
stair_thread = Data(staircase.ST)
stair_rising = Data(staircase.SR)
staircase_2 = Data(staircase.SC)

panel = Panel(stair_rising)
panel_2 = Panel(stair_landings)
panel_3 = Panel(stair_number)
panel_4 = Panel(stair_thread)
